# Grasshopper definition Hops_Bao.gh (Grasshopper 1.0.7)

get_number = GetNumber(AtLeast=1, AtMost=1, Maximum=1.797693135e+308, Minimum=-1.797693135e+308, TreeAccess=False)
get_integer = GetInteger(AtLeast=1, AtMost=1, Maximum=2147483647, Minimum=-2147483648, TreeAccess=False)
center_box = CenterBox(Base=PlaneXY(0, 0, 0), X=get_number, Y=get_number, Z=get_number)
evaluate_box = EvaluateBox(Box=center_box, UParameter=0.5, VParameter=0.5, WParameter=0.5)  # -> Plane, Point, Include
populate_3d = Populate3D(Region=center_box, Count=get_integer, Seed=1)
vector_2pt = Vector2Pt(PointA=evaluate_box.Point, PointB=populate_3d, Unitize=False)  # -> Vector, Length
plane_normal = PlaneNormal(Origin=populate_3d, ZAxis=vector_2pt.Vector)
brep_plane = BrepPlane(Brep=center_box, Plane=plane_normal)  # -> Curves, Points
curve = Curve(brep_plane.Curves)
context_bake = ContextBake(Geometry=curve)
